# Dynamo graph 3D Grid.dyn (Dynamo 0.9.1.4062)

categories = Categories("Grids")
all_elements_of_category = ElementsOfCategory(categories)
curve = Grid.Curve(all_elements_of_category)
reverse = Curve.Reverse(curve)
family_types = FamilyTypes("3D Grid:250mm")
levels = Levels("Level 0")
byCurve = Custom[FamilyInstance.ByCurve](curve=reverse, familyType=family_types, level=levels)  # Places a line-based family instance on a given level
string = StringInput("Text")
name = Family.Name(all_elements_of_category)
setParameterByName = Element.SetParameterByName(element=byCurve, parameterName=string, value=name)
